# Dynamo graph Portal_sample.dyn (Dynamo 0.7.3.3034)

number = DoubleInput(4)
number_2 = DoubleInput(3)
number_3 = DoubleInput(3)
number_4 = DoubleInput(0)
number_5 = DoubleInput(9)
number_6 = DoubleInput(15)
number_7 = DoubleInput(12)
xyzGrid = Custom[XyzGrid](x_count=number, y_count=number_2, z_count=number_3, x0=number_4, y0=number_4, z0=number_4, x_space=number_5, y_space=number_6, z_space=number_7)  # This node represents an upgrade of the 0.6.3 XyzGrid node to 0.7.x
flatten = Flatten(xyzGrid)
formula = Formula("x*y;", x=number, y=number_2)
chop = List.Chop(flatten, formula)
transpose = List.Transpose(chop)
byPoints = PolyCurve.ByPoints(transpose)
explode = Geometry.Explode(byPoints)
number_8 = DoubleInput(1)
formula_2 = Formula("z-1", z=number_3)
number_sequence = NumberSeq(number_8, formula_2, number_8, lacing=Longest)
getItemAtIndex = List.GetItemAtIndex(chop, number_sequence)
flatten_2 = Flatten(getItemAtIndex)
number_9 = DoubleInput(0)
code_block = CodeBlock(x=number, y=number_2) { x*y; }
number_sequence_2 = NumberSeq(number_9, formula_2, code_block, lacing=Longest)
number_10 = DoubleInput(1)
number_sequence_3 = NumberSeq(number_sequence_2, number, number_10, lacing=Longest)
number_sequence_4 = NumberSeq(number_sequence_3, number_2, number, lacing=Longest)
getItemAtIndex_2 = List.GetItemAtIndex(flatten_2, number_sequence_4)
byPoints_2 = PolyCurve.ByPoints(getItemAtIndex_2)
explode_2 = Geometry.Explode(byPoints_2)
flatten_3 = Flatten()
map = List.Map(explode_2, flatten_3)
integer_slider = IntegerSlider(0, range=0..4)
getItemAtIndex_3 = List.GetItemAtIndex(map, integer_slider)
code_block_2 = CodeBlock { "I want to merge these lists!"; }
chop_2 = List.Chop(flatten_2, number)
chop_3 = List.Chop(chop_2, number_2)
byPoints_3 = PolyCurve.ByPoints(chop_3)
explode_3 = Geometry.Explode(byPoints_3)
map_2 = List.Map(explode_3, flatten_3)
create = List.Create(map_2, map)
BEAMS = Flatten(create)
code_block_3 = CodeBlock { "LiveLoadSample"; }
setLoadPattern = DynamoSAP.Analysis.LoadPattern.SetLoadPattern(code_block_3)
distributedLoadOnFrame = DynamoSAP.Analysis.Load.DistributedLoadOnFrame(BEAMS, setLoadPattern)
code_block_4 = CodeBlock { "Steel"; }
fromLine = DynamoSAP.Structure.Frame.FromLine(BEAMS, code_block_4)
startPoint = Curve.StartPoint(BEAMS)
endPoint = Curve.EndPoint(BEAMS)
fromEndPoints = DynamoSAP.Structure.Frame.FromEndPoints(startPoint, endPoint, code_block_4)
