# Dynamo graph simpletest.dyn (Dynamo 0.7.2.2921)

byCoordinates = Point.ByCoordinates()
double_slider = DoubleSlider(47.119, range=0..100)
double_slider_2 = DoubleSlider(33.331, range=0..100)
byCoordinates_2 = Point.ByCoordinates(double_slider, double_slider_2)
code_block = CodeBlock { "test"; }
integer_slider = IntegerSlider(0, range=0..100)
double_slider_3 = DoubleSlider(59.484, range=0..100)
fromEndPoints = DynamoSAP.Structure.Frame.FromEndPoints(byCoordinates, byCoordinates_2, code_block, code_block, integer_slider, double_slider_3)
baseCurve = DynamoSAP.Structure.Frame.BaseCurve(fromEndPoints)
rotation = DynamoSAP.Structure.Frame.Rotation(fromEndPoints)
load = DynamoSAP.Analysis.Load.Load()
toString = ToString(fromEndPoints)
code_block_2 = CodeBlock { "myload"; }
integer_slider_2 = IntegerSlider(28, range=0..100)
double_slider_4 = DoubleSlider(0, range=0..100)
boolean = BoolSelector(false)
fromFrame = DynamoSAP.Analysis.PointLoadOnFrame.FromFrame(toString, code_block_2, integer_slider_2, integer_slider_2, double_slider_4, double_slider_4, code_block_2, boolean, boolean)
watch = Watch(fromFrame)
